# Dynamo graph 01_Informacion de Elementos.dyn (Dynamo 1.3.3.4111)

# group: Obtner elementos de una Family Type
family_types = FamilyTypes("M_Pile Cap-600 Pile:600 x 600 x 900mm")
all_elements_of_family_type = ElementsOfFamilyType(family_types)

watch = Watch(all_elements_of_family_type)

# group: Obtener Información de los elementos
code_block = CodeBlock { "Volume"; }
getParameterValueByName = Element.GetParameterValueByName(element=all_elements_of_family_type, parameterName=code_block)
code_block_2 = CodeBlock { "Mark"; }
getParameterValueByName_2 = Element.GetParameterValueByName(element=all_elements_of_family_type, parameterName=code_block_2)

# group: Parametros de los elementos
parameters = Element.Parameters(all_elements_of_family_type)
