# Dynamo graph 02_Parametros de tipo.dyn (Dynamo 1.3.3.4111)

# group: Obtner elementos por catergoria
categories = Categories("Walls")
all_elements_of_category = ElementsOfCategory(categories)

# group: Parametros de elementos
code_block = CodeBlock { "Area"; }
getParameterValueByName = Element.GetParameterValueByName(element=all_elements_of_category, parameterName=code_block)
code_block_2 = CodeBlock { "Length"; }
getParameterValueByName_2 = Element.GetParameterValueByName(element=all_elements_of_category, parameterName=code_block_2)
code_block_3 = CodeBlock { "Volume"; }
getParameterValueByName_3 = Element.GetParameterValueByName(element=all_elements_of_category, parameterName=code_block_3)
code_block_4 = CodeBlock { "Unconnected Height"; }
getParameterValueByName_4 = Element.GetParameterValueByName(element=all_elements_of_category, parameterName=code_block_4)
id = Element.Id(all_elements_of_category)

parameters = Element.Parameters(all_elements_of_category)

# group: Parametros de tipo
code_block_5 = CodeBlock { "Type"; }
getParameterValueByName_5 = Element.GetParameterValueByName(element=all_elements_of_category, parameterName=code_block_5)
code_block_6 = CodeBlock { "Width"; }
getParameterValueByName_6 = Element.GetParameterValueByName(element=getParameterValueByName_5, parameterName=code_block_6)

parameters_2 = Element.Parameters(getParameterValueByName_5)
