# Dynamo graph 03_Operaciones de tipo de datos.dyn (Dynamo 1.3.3.4111)

# group: String
code_block = CodeBlock { "Renzo"; }
string = StringInput("Renzo")

# group: Number
code_block_2 = CodeBlock { 25; }
number = DoubleInput(25)
number_slider = DoubleSlider(25, range=0..100 step 5)

# group: Boolean
code_block_3 = CodeBlock { true; }
code_block_4 = CodeBlock { false; }
boolean = BoolSelector(false)

# group: Suma de Numeros
code_block_5 = CodeBlock { 25; }
code_block_6 = CodeBlock { 30; }
code_block_7 = CodeBlock(a=code_block_5, b=code_block_6) { a+b; }
watch = Watch(code_block_7)

# group: Suma de numero y string
code_block_8 = CodeBlock { "Renzo tiene "; }
code_block_9 = CodeBlock { 25; }
code_block_10 = CodeBlock { " años"; }
code_block_11 = CodeBlock(a=code_block_8, b=code_block_9, c=code_block_10) { a+ b + c; }
watch_2 = Watch(code_block_11)

# group: Suma de string
code_block_12 = CodeBlock { "Renzo "; }
code_block_13 = CodeBlock { "Rios"; }
code_block_14 = CodeBlock(Nombre=code_block_12, Apellido=code_block_13) { Nombre+Apellido; }
watch_3 = Watch(code_block_14)
