# Dynamo graph 04_Guardar Informacion en parametros.dyn (Dynamo 1.3.3.4111)

# group: Obtener categorias de los elementos
categories = Categories("Planting")
categoria_de_elementos = ElementsOfCategory(categories)

# group: Operaciones con tipo de valores
count = Count(categoria_de_elementos)
inicio_final = CodeBlock(x=count) { 1..x; }
nomenclatura_de_elementos = CodeBlock(Numero=inicio_final) { "P-" + Numero; }

# group: Guardar información en parametros
code_block = CodeBlock { "Mark"; }
setParameterByName = Element.SetParameterByName(element=categoria_de_elementos, parameterName=code_block, value=nomenclatura_de_elementos)
