# Dynamo graph 05_Filtro de Mascara Booleana.dyn (Dynamo 1.3.3.4111)

# group: Elementos de la categoria walls
categories = Categories("Walls")
all_elements_of_category = ElementsOfCategory(categories)

# group: Filtro 1er Nivel - Muro Tipo 01
code_block = CodeBlock { "Tipo de Muro"; }
getParameterValueByName = Element.GetParameterValueByName(element=all_elements_of_category, parameterName=code_block)
code_block_2 = CodeBlock { "Tipo 01"; }
eq = getParameterValueByName == code_block_2
filterByBoolMask = List.FilterByBoolMask(list=all_elements_of_category, mask=eq)

# group: Area de Tipo 01
code_block_3 = CodeBlock { "Area"; }
getParameterValueByName_2 = Element.GetParameterValueByName(element=filterByBoolMask.in, parameterName=code_block_3)
sum = Math.Sum(getParameterValueByName_2)

# group: Filtro 2do Nivel - Muro tipo 02
code_block_4 = CodeBlock { "Tipo de Muro"; }
getParameterValueByName_3 = Element.GetParameterValueByName(element=filterByBoolMask.out, parameterName=code_block_4)
code_block_5 = CodeBlock { "Tipo 02"; }
eq_2 = getParameterValueByName_3 == code_block_5
filterByBoolMask_2 = List.FilterByBoolMask(list=filterByBoolMask.out, mask=eq_2)

# group: Area de Tipo 02
code_block_6 = CodeBlock { "Area"; }
getParameterValueByName_4 = Element.GetParameterValueByName(element=filterByBoolMask_2.in, parameterName=code_block_6)
sum_2 = Math.Sum(getParameterValueByName_4)

# group: Area de Tipo "Otros
code_block_7 = CodeBlock { "Area"; }
getParameterValueByName_5 = Element.GetParameterValueByName(element=filterByBoolMask_2.out, parameterName=code_block_7)
sum_3 = Math.Sum(getParameterValueByName_5)
