# Dynamo graph 01_Familias por Punto.dyn (Dynamo 1.3.3.4111)

# group: Obtner Elementos por categoria
categories = Categories("Planting")
all_elements_of_category = ElementsOfCategory(categories)

geometry = Element.Geometry(all_elements_of_category)

# group: Crear familias por puntos
location = FamilyInstance.Location(all_elements_of_category)
family_types = FamilyTypes("M_Pile-Steel Pipe:600mm Diameter")
byPoint = FamilyInstance.ByPoint(familyType=family_types, point=location)

# group: Puntos individuales
X = Point.X(location)
Y = Point.Y(location)
Z = Point.Z(location)
