# Dynamo graph 02_Muro por curvas.dyn (Dynamo 1.3.3.4111)

# group: Obtner curvas de elementos seleccionados
select_model_elements = DSModelElementsSelection()  # 2 picked in the model
curves = Element.Curves(select_model_elements)

# group: Crear un muro a partir de un curvas
code_block = CodeBlock { 1.50; }
levels = Levels("Level 1")
wall_types = WallTypes("Wall - Timber Clad")
byCurveAndHeight = Wall.ByCurveAndHeight(curve=curves, height=code_block, level=levels, wallType=wall_types)
