# Dynamo graph 03_ExportarExcel.dyn (Dynamo 1.3.3.4111)

# group: Obtener Elementos
categories = Categories("Walls")
all_elements_of_category = ElementsOfCategory(categories)

# group: Obtener informacion de elementos
id = Element.Id(all_elements_of_category)
code_block = CodeBlock { "Volume"; }
getParameterValueByName = Element.GetParameterValueByName(element=all_elements_of_category, parameterName=code_block)

# group: Ordenar información
create = List.Create(id, getParameterValueByName)
transpose = List.Transpose(create)

# group: Exportar información a excel
file_path = Filename("D:\Usuarios\rrios\Escritorio\Automatización BIM - Grupo 02\Clase 03\03_ExportarExcel.xlsx")
code_block_2 = CodeBlock { "Hoja1"; }
code_block_3 = CodeBlock { 2; 2; }
writeToFile = Excel.WriteToFile(filePath=file_path, sheetName=code_block_2, startRow=code_block_3.out0, startCol=code_block_3.out1, data=transpose)
