# Dynamo graph 01_Crear Reporte.dyn (Dynamo 1.3.3.4111)

# group: Selección de Elementos
# note: Seleccionar Elementos en Revit:
# - Select Model Element (Elementos de manera individual o un grupo de elementos)
# -Type: All Element of type
# -Category: All Element of category
# - All Element in Active View

fecha_actual = CodeBlock { "06_08_2019"; }
all_elements_in_active_view = ElementsInView()

# group: Lista sin valores repetidos
categoryName = Elements.Element.CategoryName(all_elements_in_active_view)
uniqueItems = List.UniqueItems(categoryName)

# group: Agrupar elementos
categoryName_2 = Elements.Element.CategoryName()  # unwired: arg0
groupByFunction = GroupByFunction(all_elements_in_active_view, categoryName_2)

# group: Crear texto para exportar
count = Count(groupByFunction, lacing=Longest)
code_block = CodeBlock(fecha=fecha_actual, categoria=uniqueItems, cantidad=count)
# ---------- code_block.designscript (4 lines) ----------
"###REPORTE DE CATEGORIAS DENTRO DEL PROYECTO###";
"Fecha: " + fecha;
 "Categorias del proyecto";
 categoria + " : " + cantidad +" elementos";
# ----------------------------------------
create = List.Create(code_block.out0, code_block.out1, code_block.out2, code_block.out3)
flatten = Flatten(create)
listToStringLines = Strings.String.listToStringLines(flatten)

# group: Exportar Informacion
directory_path = Directory("D:\Usuarios\rrios\Escritorio")
code_block_2 = CodeBlock(ruta=directory_path, fecha=fecha_actual) { ruta + "\\" + "Reporte " + fecha + ".doc"; }
writeText = File.WriteText(code_block_2, listToStringLines)
watch = Watch(code_block_2)
