# Dynamo graph 02_Exportar Mobiliario.dyn (Dynamo 1.3.3.4111)

# group: Elementos de una categoria
categories = Categories("Furniture")
all_elements_of_category = ElementsOfCategory(categories)

# group: Informacion de elementos
id = Element.Id(all_elements_of_category)
categoryName = Elements.Element.CategoryName(all_elements_of_category)
code_block = CodeBlock { "Mark"; }
getParameterValueByName = Element.GetParameterValueByName(element=all_elements_of_category, parameterName=code_block)

create = List.Create(id, categoryName, getParameterValueByName)

# group: Exportar a Excel
file_path = Filename("D:\Usuarios\rrios\Escritorio\Mobiliario.xlsx")
code_block_2 = CodeBlock { "Hoja1"; }
code_block_3 = CodeBlock { 0; }
transpose = List.Transpose(create)
writeToFile = Excel.WriteToFile(filePath=file_path, sheetName=code_block_2, startRow=code_block_3, startCol=code_block_3, data=transpose)

# group: Guardar informacion en parametros
code_block_4 = CodeBlock { "Mark"; }
count = Count(all_elements_of_category)  # frozen
code_block_5 = CodeBlock(x=count) { 1..x; }
code_block_6 = CodeBlock(numero=code_block_5) { "M - "+ numero; }
setParameterByName = Element.SetParameterByName(element=all_elements_of_category, parameterName=code_block_4, value=code_block_6)
