# Dynamo graph 03_Importar Informacion de excel.dyn (Dynamo 1.3.3.4111)

# group: Leer Informacion de un archivo de excel
file_path = Filename("D:\Usuarios\rrios\Escritorio\Mobiliario.xlsx")
fromPath = FileObject(file_path)  # "File.FromPath"
code_block = CodeBlock { "Hoja1"; }
readFromFile = Excel.ReadFromFile(file=fromPath, sheetName=code_block)

# group: Trabajar con listas
code_block_2 = CodeBlock { 1; }
dropItems = List.DropItems(list=readFromFile, amount=code_block_2)
transpose = List.Transpose(dropItems)
code_block_3 = CodeBlock(x=transpose) { x[0]; }
code_block_4 = CodeBlock(x=transpose) { x[1]; }
code_block_5 = CodeBlock(x=transpose) { x[2]; }

# group: Guardar informacion en elementos
categories = Categories("Furniture")
all_elements_of_category = ElementsOfCategory(categories)
code_block_6 = CodeBlock { "Mark"; }
setParameterByName = Element.SetParameterByName(element=all_elements_of_category, parameterName=code_block_6, value=code_block_5)
