# Dynamo graph 04_ColorOverride.dyn (Dynamo 1.3.3.4111)

# group: Obtner Elementos
categories = Categories("Walls")
all_elements_of_category = ElementsOfCategory(categories)

# group: Filtro de elemtos
code_block = CodeBlock { "Length"; }
getParameterValueByName = Element.GetParameterValueByName(element=all_elements_of_category, parameterName=code_block)
number = DoubleInput(5)
ge = getParameterValueByName >= number
filterByBoolMask = List.FilterByBoolMask(list=all_elements_of_category, mask=ge)

# group: Color Override
code_block_2 = CodeBlock { 50; 95; 168; }
byARGB = Color.ByARGB(r=code_block_2.out0, g=code_block_2.out1, b=code_block_2.out2)
overrideColorInView = Element.OverrideColorInView(element=filterByBoolMask.in, color=byARGB)
