# Dynamo graph 01_Isolate Elements.dyn (Dynamo 1.3.3.4111)

# group: Obtener Elementos
categories = Categories("Walls")
all_elements_of_category = ElementsOfCategory(categories)

# group: Obtener Información de los elementos
code_block = CodeBlock { "Length"; }
getParameterValueByName = Element.GetParameterValueByName(element=all_elements_of_category, parameterName=code_block)

# group: Filtro de elementos mayores a 5.00 m
longitud_maxima = CodeBlock { 5; }
ge = getParameterValueByName >= longitud_maxima
filterByBoolMask = List.FilterByBoolMask(list=all_elements_of_category, mask=ge)

# group: Isolate elements
views = Views("Test View")
temporarilyIsolateElement = Custom[View.TemporarilyIsolateElement](view=views, element=filterByBoolMask.in)  # Temporarily isolates elements in the given view
