# Dynamo graph 02_Piper by Curve.dyn (Dynamo 1.3.3.4111)

# group: Curvas de elementos
select_model_elements = DSModelElementsSelection()  # 8 picked in the model
curves = Element.Curves(select_model_elements)

# group: Informacion para crear tuberias
nameCollector = Elements.PipingSystemType.NameCollector()
code_block = CodeBlock(Out=nameCollector) { Out[3]; }
byName = Elements.PipingSystemType.ByName(code_block)
nameCollector_2 = Elements.PipeType.NameCollector()
code_block_2 = CodeBlock(Out=nameCollector_2) { Out[0]; }
byName_2 = Elements.PipeType.ByName(code_block_2)
levels = Levels("Level 1")

byCurve = Elements.Pipe.ByCurve(curves, byName, byName_2, levels)
