# Dynamo graph 03_Exportar Observaciones.dyn (Dynamo 1.3.3.4111)

directory_path = Directory("D:\Usuarios\rrios\Escritorio")
code_block = CodeBlock(ruta=directory_path) { ruta + "\\Observaciones.xlsx"; }
code_block_2 = CodeBlock { "Hoja1"; }
code_block_3 = CodeBlock { 0; }
categories = Categories("RevisionClouds")
all_elements_of_category = ElementsOfCategory(categories)
count = Count(all_elements_of_category)
code_block_4 = CodeBlock(x=count) { 1..x; }
code_block_5 = CodeBlock { "Comments"; }
getParameterValueByName = Element.GetParameterValueByName(element=all_elements_of_category, parameterName=code_block_5)
create = List.Create(code_block_4, getParameterValueByName)
transpose = List.Transpose(create)
writeToFile = Excel.WriteToFile(filePath=code_block, sheetName=code_block_2, startRow=code_block_3, startCol=code_block_3, data=transpose)
