# Dynamo graph 05_DP_IsolateElemets.dyn (Dynamo 1.3.3.4111)

code_block = CodeBlock { "Walls"; }
views = Views("3D View")
number = DoubleInput(5)
string = StringInput("Walls")
byName = Category.ByName(string)
all_elements_of_category = ElementsOfCategory(byName)
X = Custom[Elements.Major.X](double=number, Walls=all_elements_of_category)  # Filtra los muros con longitud mayor a "X"
temporarilyIsolateElement = Custom[View.TemporarilyIsolateElement](view=views, element=X)  # Temporarily isolates elements in the given view
