# Dynamo graph 06_DP_IdElements.dyn (Dynamo 1.3.3.4111)

all_elements_in_active_view = ElementsInView()
string = StringInput("Comments")
id = Element.Id(all_elements_in_active_view)
string_from_object = FromObject(id)
setParameterByName = Element.SetParameterByName(element=all_elements_in_active_view, parameterName=string, value=string_from_object)
