# Dynamo custom node Type parameters.dyf (Dynamo 1.3.3.4111)
# category: Automatizacion BIM - Grupo 02
# Obtiene la lista de los parametros tipo de un elemeno

Elements = Input()
code_block = CodeBlock { "Type"; }
getParameterValueByName = Element.GetParameterValueByName(element=Elements, parameterName=code_block)
parameters = Element.Parameters(getParameterValueByName)
Parameter = Output(parameters)
