# Dynamo custom node Walls.Major.X.dyf "Elements.Major.X" (Dynamo 1.3.3.4111)
# category: Automatizacion BIM - Grupo 02
# Filtra los muros con longitud mayor a "X"

Walls = Input()
code_block = CodeBlock { "Length"; }
getParameterValueByName = Element.GetParameterValueByName(element=Walls, parameterName=code_block)
double = Input()
ge = getParameterValueByName >= double
filterByBoolMask = List.FilterByBoolMask(list=Walls, mask=ge)
Elements = Output(filterByBoolMask.in)
